# Grasshopper definition 211029_GHAutoknit_Example.gh (Grasshopper 1.0.7)
# Copyright: 2019

# ----
# Reference geometry
mesh = Mesh(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)

# ----
# Extract boundaries and define autoknit-compatible constraints
toggle = BooleanToggle(True)
mesh_2 = Mesh(mesh)
filter = StreamFilter(Gate=toggle, Stream1=mesh_2)
medges = MeshEdges(Mesh=filter)  # -> NakedEdges, InteriorEdges, NonManifoldEdges
join = JoinCurves(Curves=medges.NakedEdges, Preserve=False)
item = ListItem(List=join, Index=0, Wrap=True)  # -> Item, Item1
explode = Explode(Curve=item.Item, Recursive=True)  # -> Segments, Vertices
explode_2 = Explode(Curve=item.Item1, Recursive=True)  # -> Segments, Vertices
bacfp = BuildAutoknitConstraintFromPoints(Points=explode_2.Vertices, Value=Slider(1, range=0..100))  # -> Constraint; inputs Points: list of Point3d
# ---------- bacfp: Python ----------
"""
Build an autoknit constraint (AKConstraint) from a list of points
and a time value.
    Inputs:
        P: The points to build the constraint with. {list, points}
        V: The value to build the constraint with. {item, float}
    Outputs:
        AKConstraint: The constraint as AKConstraint. {list, AKConstraint}
    Remarks:
        Author: Max Eschenbach
        License: MIT License
        Version: 211029
"""

# PYTHON STANDARD LIBRARY IMPORTS
from __future__ import division

# GHPYTHON SDK IMPORTS
from ghpythonlib.componentbase import executingcomponent as component
import Grasshopper, GhPython
import System
import Rhino
import rhinoscriptsyntax as rs

# LOCAL MODULE IMPORTS
import ghautoknit as ghak

# GHENV COMPONENT SETTINGS
ghenv.Component.Name = "BuildAutoknitConstraintFromPoints"
ghenv.Component.NickName ="BACFP"
ghenv.Component.Category = "GHAutoknit"
ghenv.Component.SubCategory = "1 Autoknit Constraints"

class BuildAutoknitConstraintFromPoints(component):
    
    def RunScript(self, P, V):
        # define outputs so they're never empty
        AKConstraint = None
        
        AKConstraint = ghak.Constraint(-1, P, V, 0)
        
        
        # return outputs if you have them; here I try it for you:
        return (AKConstraint)
# ---------- end bacfp ----------
bacfp_2 = BuildAutoknitConstraintFromPoints(Points=explode.Vertices, Value=Slider(0, range=0..100))  # -> Constraint; inputs Points: list of Point3d; same code as bacfp
dots = DotDisplay(Point=explode.Vertices, Colour=RGB(0, 102, 255), Size=0.08)
dots_2 = DotDisplay(Point=explode_2.Vertices, Colour=RGB(255, 0, 0), Size=0.08)
constraintatend = Data(bacfp)
constraintatstart = Data(bacfp_2)

# ----
# Build Autoknit model
# from mesh and defined constraints
constraintatstart_2 = Data(constraintatstart)
constraintatend_2 = Data(constraintatend)
mesh_3 = Mesh(mesh)
bam = BuildAutoknitModel(Mesh=mesh_3, Constraints=[constraintatstart_2, constraintatend_2])  # -> Model; inputs Mesh: Mesh, Constraints: list
# ---------- bam: Python ----------
"""
Load an Autoknit *.cons file and interpret the constraints in it.
    Inputs:
        Mesh: The mesh to build the model with {item, mesh}
        Constraints: The constraints to build the model with as Autoknit Constraints {list, Autoknit Constraint}
    Outputs:
        Model: The vertices from the constraint file as tuples {list, Autoknit Model}
    Remarks:
        Author: Max Eschenbach
        License: MIT License
        Version: 211029
"""

# PYTHON STANDARD LIBRARY IMPORTS
from __future__ import division
from string import join

# GHPYTHON SDK IMPORTS
from ghpythonlib.componentbase import executingcomponent as component
import Grasshopper, GhPython
import System
import Rhino
import rhinoscriptsyntax as rs

# LOCAL MODULE IMPORTS
import ghautoknit as ghak

# GHENV COMPONENT SETTINGS
ghenv.Component.Name = "BuildAutoknitModel"
ghenv.Component.NickName ="BAM"
ghenv.Component.Category = "GHAutoknit"
ghenv.Component.SubCategory = "2 Autoknit Model"

class BuildAutoknitModel(component):
    
    def RunScript(self, M, C):
        # define outputs so they're never empty
        AKModel = None
        
        if not M:
            return None
        if not C:
            C = None
        
        for i, c in enumerate(C):
            if type(c) is not ghak.Constraint:
                raise ValueError("Supplied constraint {i} is not a valid " + \
                                 "AKConstraint!".format(i))
        
        # create model
        AKModel = ghak.Model(M, C)
        
        # return outputs if you have them; here I try it for you:
        return (AKModel)
# ---------- end bam ----------
autoknitmodel = Data(bam)

# ----
# Run Autoknit and peel model using constraints
save_traced_path = Panel("C:\Users\%USERNAME%\Desktop\test.st")
obj_scale = Slider(10, range=0.5..20)
stitch_height = Slider(1.73, range=0.5..7)
stitch_width = Slider(3.66, range=0.5..7)
peel_step = Slider(10, range=-1..40)
autoknitmodel_2 = Data(autoknitmodel)
rafm = RunAutoknitFromModel(
    Run=Button(),
    Model=autoknitmodel_2,
    obj_scale=obj_scale,
    stitch_width=stitch_width,
    stitch_height=stitch_height,
    save_traced=save_traced_path,
    peel_step=peel_step)  # -> R; inputs peel_step: Int32
# ---------- rafm: Python ----------
"""
Run Autoknit as a threaded subprocess from an Autoknit Model.
TODO: update docstring
    Inputs:
        Run: Connect a button and set to true to start the autoknit instance {item, boolean}
        Model: 
        obj_scale: {item, float}
        stitch_width: {item, float}
        stitch_height: {item, float}
        save_traced: Path where the traced file (*.st) should be saved when peeling is finished {item, str}
        peel_step: Number of steps to peel the model. -1 will peel the whole model {item, int}
    Outputs:
        R: Boolean identifying if this autoknit instance is currently running or not {item, boolean}
    Remarks:
        Author: Max Eschenbach
        License: MIT License
        Version: 211029
"""

# PYTHON STANDARD LIBRARY IMPORTS
from __future__ import division
import subprocess
import threading
import os

# GHPYTHON SDK IMPORTS
from ghpythonlib.componentbase import executingcomponent as component
import Grasshopper, GhPython
import System
import Rhino
import rhinoscriptsyntax as rs

# RHINO IMPORTS
from scriptcontext import sticky as st

# LOCAL MODULE IMPORTS
import ghautoknit as ghak

# GHENV COMPONENT SETTINGS
ghenv.Component.Name = "RunAutoknitFromModel"
ghenv.Component.NickName ="RAFM"
ghenv.Component.Category = "GHAutoknit"
ghenv.Component.SubCategory = "3 Run Autoknit"

class RunAutoknitFromModel(component):
    
    def RunScript(self, Run, Model, obj_scale, stitch_width, stitch_height, save_traced, peel_step):
        
        # SETUP CODE -----------------------------------------------------------
        
        running_key, reset_key = ghak.Engine.InitializeComponentInterface(self)
        
        if running_key not in st:
            st[running_key] = False
        if reset_key not in st:
            st[reset_key] = False
        
        # THREADED FUNCTION DEFINTION ------------------------------------------
        
        # define threaded call function
        def threaded_call():
            retcode = subprocess.call(Command)
            st[running_key] = False
            st[reset_key] = True
            
            try:
                os.remove(temp_model)
                os.remove(temp_cons)
            except Exception, e:
                print e
            
            self.ExpireSolution(True)
            return retcode
        
        # COMMAND COMPILATION --------------------------------------------------
        
        filedir = os.path.dirname(ghdoc.Path)
        temp_model, temp_cons = ghak.Engine.TempFilePaths(filedir)
        
        Command = ghak.Engine.CompileCommand(temp_model,
                                            temp_cons,
                                            obj_scale,
                                            stitch_width,
                                            stitch_height,
                                            save_traced,
                                            peel_step)
        
        # throw runtime message and abort if path is not set correctly!
        if not Command:
            rml = self.RuntimeMessageLevel.Warning
            self.AddRuntimeMessage(rml, "_AK_RAW_PATH_ is not set correctly! " +
                                        "Please open Environment.py and set " +
                                        "the path to your autoknit " +
                                        "installation.\nCurrent path is:\n" +
                                        ghak.Environment._AK_PATH_)
            return False
        
        # START AUTOKNIT THREAD ------------------------------------------------
        
        if Run and st[running_key] is False:
            # write temporary files
            ghak.Engine.WriteTempFiles(Model, temp_model, temp_cons)
            # make thread and start it
            thread = threading.Thread(target=threaded_call)
            thread.start()
            # set keys
            st[running_key] = True
            st[reset_key] = False
        
        if st[reset_key] is True:
            st[running_key] = False
        
        # return info about running autoknit thread
        R = st[running_key]
        self.Message = "Autoknit Running: " + str(st[running_key])
        
        # return outputs if you have them; here I try it for you:
        return R
# ---------- end rafm ----------
autoknit_running = Panel(rafm)
